# Grasshopper definition Geenerative Urban Planning.gh (Grasshopper 1.0.7)
# plug-ins: MeerkatGIS

shapefile = ImportShapefile(OnOff=Toggle(False))
path = FilePath("C:\Users\ek542\Documents\GitHub\ArcRhino\UseCase\BFN_Buildings.mkgis")
path_2 = FilePath("C:\Users\ek542\Documents\GitHub\ArcRhino\UseCase\BFN_StreetEdge.mkgis")
parse_mkgis = ParseMeerkatFile(MeerkatFile=path)  # -> DateCropped, UserAndMachineNamed, PathForFiles, ShapeType, ShapeCountInSource, BoundsInPointSpace, BoundsInLatLong, FieldNames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
parse_mkgis_2 = ParseMeerkatFile(MeerkatFile=path_2)  # -> DateCropped, UserAndMachineNamed, PathForFiles, ShapeType, ShapeCountInSource, BoundsInPointSpace, BoundsInLatLong, FieldNames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
incurves = PointInCurves()  # -> Relationship, Index, Point
pt = Point(parse_mkgis.GeometryPerShape)
panel = Panel(parse_mkgis.FieldNames)
pline = PolyLine(Vertices=parse_mkgis_2.GeometryPerShape, Closed=False)
pline_2 = PolyLine(Vertices=parse_mkgis.GeometryPerShape, Closed=Toggle(True))
bbox = BoundingBox(Content=pline, Plane=PlaneXY(0, 0, 0))  # -> Box, Box_2
divide = DivideCurve(Curve=pline, Count=Slider(4, range=0..10), Kinks=False)  # -> Points, Tangents, Parameters
debrep = DeconstructBrep(Brep=bbox.Box_2)  # -> Faces, Edges, Vertices
number_slider = Slider(36, range=0..100)
ins = InsertItems(List=parse_mkgis.FieldValuesPerShape, Item=pline_2, Indices=Slider(21, range=0..100), Wrap=True)
join = JoinCurves(Curves=flatten(debrep.Edges), Preserve=False)  # -> flatten(Curves)
geo = Geometry(flatten(join))
geo_2 = Geometry(parse_mkgis_2.BoundsInPointSpace)
sqgrid = Square(Plane=geo_2, Size=Slider(31, range=0..100), ExtentX=number_slider, ExtentY=number_slider)  # -> flatten(Cells), Points
area = Area(Geometry=sqgrid.Cells)  # -> Area, Centroid
filter = GhPythonScript(tree=ins, upper_area=Slider(5000, range=0..20000), lower_area=Slider(1000, range=0..20000))  # -> out, a; inputs tree: tree, upper_area: Int32, lower_area: Int32
# ---------- filter: Python ----------
__author__ = "ek542"
__version__ = "2019.10.19"

import rhinoscriptsyntax as rs
from System import Object
import Grasshopper.Kernel as gh
from Grasshopper import DataTree
from Grasshopper.Kernel.Data import GH_Path

tree_new = DataTree[Object]()
count = 0

for i in range(tree.BranchCount):
    branch = tree.Branch(i)
    area = float(branch[20])
    price = float(branch[7])
    if (area >= lower_area and area <= upper_area and price > 100):
         path = GH_Path(count)
         for item in branch:
            tree_new.Add(item, path)
         count +=  1

a = tree_new
# ---------- end filter ----------
incurve = PointInCurve(Point=area.Centroid)  # -> Relationship, Point
incurves_2 = PointInCurves(Point=area.Centroid, Curves=flatten(pline))  # -> Relationship, Index, Point
dispatch = Dispatch(List=area.Centroid, DispatchPattern=incurves_2.Relationship)  # -> ListA, ListB
item = ListItem(List=filter.a, Index="21", Wrap=True)
geo_3 = Geometry(dispatch.ListA)
geo_4 = Geometry(item)
area_2 = Area(Geometry=geo_4)  # -> Area, flatten(Centroid)
item_2 = ListItem(List=ins, Index=Slider(21, range=0..100), Wrap=True)  # -> flatten(Item)
incurves_3 = PointInCurves(Point=geo_3, Curves=flatten(item_2))  # -> Relationship, Index, Point
dispatch_2 = Dispatch(List=geo_3, DispatchPattern=incurves_3.Relationship)  # -> ListA, ListB
geo_5 = Geometry(dispatch_2.ListB)
area_3 = Area(Geometry=item_2)  # -> Area, Centroid

# ---- group: HEIGHTS / Iterate
number_slider_2 = Slider(10, range=0..45)
item_3 = ListItem(List=area_2.Centroid, Index=number_slider_2, Wrap=True)  # -> flatten(Item)
dist = Distance(PointA=item_3, PointB=area_3.Centroid)

# ----
item_4 = ListItem(List=filter.a, Index="7", Wrap=True)  # -> flatten(Item)

# ---- group: HEIGHTS / Visualize Iteration
item_5 = ListItem(List=flatten(geo_4), Index=number_slider_2, Wrap=True)
boundary = BoundarySurfaces(Edges=item_5)

# ----
item_6 = ListItem(List=item_4, Index=number_slider_2, Wrap=True)
larger = LargerThan(FirstNumber=dist, SecondNumber=1)  # -> LargerThan, OrEqualTo
dispatch_3 = Dispatch(List=area_3.Centroid, DispatchPattern=larger.LargerThan)  # -> ListA, ListB
dispatch_4 = Dispatch(List=dist, DispatchPattern=larger.LargerThan)  # -> ListA, ListB

# ---- group: HEIGHTS
max_distance = Slider(202, range=0..1000)
item_7 = ListItem(List=parse_mkgis.FieldValuesPerShape, Index=Slider(18, range=0..20), Wrap=True)
larger_2 = LargerThan(FirstNumber=dispatch_4.ListA, SecondNumber=max_distance)  # -> LargerThan, OrEqualTo
trunc = Truncate(Input=item_7, TruncationFactor="0.9")  # -> flatten(Result)
heights = Dispatch(List=trunc, DispatchPattern=larger_2.LargerThan)  # -> ListA, ListB
distance = Dispatch(List=dispatch_4.ListA, DispatchPattern=larger_2.LargerThan)  # -> ListA, ListB

# ---- group: HEIGHTS / Visualize Bldgs
nearby_bldgs = Dispatch(List=dispatch_3.ListA, DispatchPattern=larger_2.LargerThan)  # -> ListA, ListB
geo_6 = Geometry(nearby_bldgs.ListB)

# ---- group: HEIGHTS / WEIGHTED AVERAGE
ma = MassAddition(Input=distance.ListB)  # -> Result, PartialResults
division = Division(A=distance.ListB, B=ma.Result)
multiplication = Multiplication(A=heights.ListB, B=division)
ma_2 = MassAddition(Input=multiplication)  # -> Result, PartialResults

# ----
galapagos = Galapagos(fitness=addition, gene=number_slider_2)
addition = Addition(A=ma_2.Result, B=item_6)
